# Grasshopper definition siteTest.gh (Grasshopper 1.0.7)

number_slider = Slider(16, range=0..100)
crv = Curve(<curve referenced from the Rhino model>)
Z = UnitZ(Factor=number_slider)
number_slider_2 = Slider(17, range=0..100)
explode = Explode(Curve=crv, Recursive=True)  # -> Segments, Vertices
vec = Vector([Vector(-0.8130194485, 0.5497636165, -0.1917272602), Vector(-0.7397797634, 0.6112653076, -0.281212776), Vector(-0.6521411067, 0.666395093, -0.3614271115), Vector(-0.5518092651, 0.7140799342, -0.430808986), Vector(-0.4407370839, 0.7533917, -0.4880079602), Vector(-0.3210864567, 0.7835652316, -0.5319107211)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])
crv_2 = Curve(<curve referenced from the Rhino model>)
crv_3 = Curve(<curve referenced from the Rhino model>)
crv_4 = Curve(<curve referenced from the Rhino model>)
crv_5 = Curve(<curve referenced from the Rhino model>)
vec_2 = Vector([Vector(-0.8130194485, 0.5497636165, -0.1917272602), Vector(-0.7397797634, 0.6112653076, -0.281212776), Vector(-0.6521411067, 0.666395093, -0.3614271115), Vector(-0.5518092651, 0.7140799342, -0.430808986), Vector(-0.4407370839, 0.7533917, -0.4880079602), Vector(-0.3210864567, 0.7835652316, -0.5319107211)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])
item = ListItem(List=explode.Vertices, Index=0, Wrap=True)
move = Move(Geometry=item, Motion=Z)  # -> Geometry, Transform
c_script = CSharpScript(p1=crv_4, p2=crv_5)  # -> out, A; inputs p1: Polyline, p2: Polyline
# ---------- c_script: C# usings ----------
using System.Linq;
# ---------- c_script: C# ----------
    var p11 = p1.ToPolylineCurve();
    var p22 = p2.ToPolylineCurve();
    //List<double> dist = new List<double>();
    var line = CheckDistance(p11, p22);
    if (line.Length < 10)
    {
      A = line;
    }
# ---------- c_script: C# additional code ----------
  public Line CheckDistance(PolylineCurve p11, PolylineCurve p22)
  {
    var d = double.MaxValue;
    Line line = new Line();

    for (int i = 0; i < p11.PointCount - 1; i++)
    {
      var pt = p11.Point(i);
      double t;
      var result = p22.ClosestPoint(pt, out t);
      double distance = pt.DistanceTo(p22.PointAt(t));

      if (distance < d)
      {
        line = new Line(pt, p22.PointAt(t));
        d = distance;
      }
    }
    for (int i = 0; i < p22.PointCount - 1; i++)
    {
      var pt = p22.Point(i);
      double t;
      var result = p11.ClosestPoint(pt, out t);
      double distance = pt.DistanceTo(p11.PointAt(t));

      if (distance < d)
      {
        line = new Line(pt, p11.PointAt(t));
        d = distance;
      }
    }
    return line;
  }
# ---------- end c_script ----------
c_script_2 = CSharpScript(vects=vec, p1=crv, height=number_slider)  # -> out, A; inputs vects: list of Vector3d, p1: Polyline, height: Double
# ---------- c_script_2: C# usings ----------
using System.Linq;
using Rhino.Geometry.Intersect;
# ---------- c_script_2: C# ----------
    var p2 = p1.ToPolylineCurve();
    p2.Translate(new Vector3d(0, 0, height));
    //    for (int i = 0; i < p2.PointCount-1; i++)
    //    {
    //
    //    }

    var pt = p2.Point(0);

    var pts = vects.Select(x => Intersection(pt, x)).ToList();

    A = pts;
# ---------- c_script_2: C# additional code ----------
  public Point3d Intersection(Point3d pt, Vector3d v)
  {
    var line = new Line(pt, v, double.MaxValue);
    double t;
    Rhino.Geometry.Intersect.Intersection.LinePlane(line,Plane.WorldXY,out t);
    return line.PointAt(t);
  }
# ---------- end c_script_2 ----------
c_script_3 = CSharpScript(vects=vec_2, p1=crv_3, height=number_slider)  # -> out, A; inputs vects: list of Vector3d, p1: Polyline, height: Double
# ---------- c_script_3: C# ----------
    var p2 = p1.ToPolylineCurve();
    p2.Translate(new Vector3d(0, 0, height));
//    for (int i = 0; i < p2.PointCount-1; i++)
//    {
//      
//    }
    
    var pt = p2.Point(0);
    var pts = vects.Select(x => new Line(pt, x*200)).ToList();
    A = pts;
# ---------- end c_script_3 ----------
vec_3 = Vector(Vector(-0.6521411067, 0.666395093, -0.3614271115))
vec_4 = Vector(Vector(0.6521411067, 0.666395093, -0.3614271115))
c_script_4 = CSharpScript(v1=vec_3, v2=vec_4, p1=crv, height=number_slider)  # -> out, A, B, C, D; inputs v1: Vector3d, v2: Vector3d, p1: Polyline, height: Double
# ---------- c_script_4: C# ----------
    var p2 = p1.ToPolylineCurve();
    p2.Translate(new Vector3d(0, 0, height));
    //    for (int i = 0; i < p2.PointCount-1; i++)
    //    {
    //
    //    }
    var pts = new List<Point3d>();
    for (int i = 0; i < p2.PointCount - 1; i++)
    {
      pts.Add(p2.Point(i));
    }

    var ptlist = GetShadow(pts, v1, v2);
    A = ptlist;
    B = l1;
    C = l2;
    D = res;
# ---------- c_script_4: C# additional code ----------
  Line l1;
  Line l2;
  bool res;


  public List<Point3d> GetShadow(List<Point3d> pts, Vector3d v1, Vector3d v2)
  {
    var corner1 = pts
      .OrderBy(x => -1 * Intersept(x, v1))
      .First();
    var p1 = GetPoint(corner1, v1);

    var corner2 = pts
      .OrderBy(x => -1 * Intersept(x, v2))
      .First();
    var p2 = GetPoint(corner2, v2);

    l1 = new Line(corner1, p1);
    l2 = new Line(corner2, p2);

    var result = TestIntersection(corner1, p1, corner2, p2);
    res = result;

    if (!result)
    {
      return new List<Point3d>() {corner1, p1, p2, corner2};
    }
    else
    {
      var intersectPt = GetIntersectPoint(p1, corner1, p2, corner2);
      return new List<Point3d>(){corner1, intersectPt, corner2};;
    }

  }

  public Point3d GetIntersectPoint(Point3d p1, Point3d p2, Point3d p3, Point3d p4)
  {
    var x_dem = p4.X * p2.Y - p4.X * p1.Y - p3.X * p2.Y + p3.X * p1.Y
      - p2.X * p4.Y + p2.X * p3.Y + p1.X * p4.Y - p1.X * p3.Y;
    var x_cor = p3.Y * p4.X * p2.X - p4.Y * p3.X * p2.X - p3.Y * p4.X * p1.X + p4.Y * p3.X * p1.X
      - p1.Y * p2.X * p4.X + p2.Y * p1.X * p4.X + p1.Y * p2.X * p3.X - p2.Y * p1.X * p3.X;

    var y_dem = p4.Y * p2.X - p4.Y * p1.X - p3.Y * p2.X + p3.Y * p1.X
      - p2.Y * p4.X + p2.Y * p3.X + p1.Y * p4.X - p1.Y * p3.X;
    var y_cor = -p3.Y * p4.X * p2.Y + p4.Y * p3.X * p2.Y + p3.Y * p4.X * p1.Y - p4.Y * p3.X * p1.Y
      + p1.Y * p2.X * p4.Y - p1.X * p2.Y * p4.Y - p1.Y * p2.X * p3.Y + p2.Y * p1.X * p3.Y;

    return new Point3d(x_cor / x_dem, y_cor / y_dem, 0);
  }

  public bool TestIntersection(Point3d p_1, Point3d p_2, Point3d p_3, Point3d p_4)
  {
    var p1 = new Point3d(p_1.X, p_1.Y, 0);
    var p2 = new Point3d(p_2.X, p_2.Y, 0);
    var p3 = new Point3d(p_3.X, p_3.Y, 0);
    var p4 = new Point3d(p_4.X, p_4.Y, 0);

    if (Math.Max(p3.X, p4.X) < Math.Min(p1.X, p2.X) ||
      Math.Max(p1.X, p2.X) < Math.Min(p3.X, p4.X) ||
      Math.Max(p3.Y, p4.Y) < Math.Min(p1.Y, p2.Y) ||
      Math.Max(p1.Y, p2.Y) < Math.Min(p3.Y, p4.Y))
    {
      return false;
    }

    if (Vector3d.CrossProduct((p1 - p4), (p3 - p4)) * Vector3d.CrossProduct((p2 - p4), (p3 - p4)) > 0 ||
    Vector3d.CrossProduct((p4 - p2), (p1 - p2)) * Vector3d.CrossProduct((p3 - p2), (p1 - p2)) > 0){
      return false;
    }
    return true;
  }

  public Point3d GetPoint(Point3d pt, Vector3d dir)
  {
    var x_cor = -1 * (dir.X / dir.Z) * pt.Z + pt.X;
    var y_cor = -1 * (dir.Y / dir.Z) * pt.Z + pt.Y;
    return new Point3d(x_cor, y_cor, 0);
  }

  public double Intersept(Point3d pt, Vector3d dir)
  {
    return -1 * (dir.Y / dir.X) * pt.X + pt.Y;
  }


  //  public Point3d Intersection(Point3d pt, Vector3d v)
  //  {
  //    var line = new Line(pt, v, double.MaxValue);
  //    double t;
  //    Rhino.Geometry.Intersect.Intersection.LinePlane(line, Plane.WorldXY, out t);
  //    return line.PointAt(t);
  //  }
# ---------- end c_script_4 ----------
vdis = VectorDisplay(Anchor=move.Geometry, Vector=vec_3)
pline = PolyLine(Vertices=c_script_2.A, Closed=False)
ln = Line(StartPoint=move.Geometry, EndPoint=c_script_2.A)
panel = Panel(vec_4)
pline_2 = PolyLine(Vertices=c_script_4.A, Closed=False)
panel_2 = Panel(c_script_4.out)
crv_6 = Curve(<curve referenced from the Rhino model>)
explode_2 = Explode(Curve=crv_6, Recursive=True)  # -> Segments, Vertices
vec_5 = Vector([Vector(-0.8130194485, 0.5497636165, -0.1917272602), Vector(-0.7397797634, 0.6112653076, -0.281212776), Vector(-0.6521411067, 0.666395093, -0.3614271115), Vector(-0.5518092651, 0.7140799342, -0.430808986), Vector(-0.4407370839, 0.7533917, -0.4880079602), Vector(-0.3210864567, 0.7835652316, -0.5319107211)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])
item_2 = ListItem(List=explode_2.Vertices, Index=0, Wrap=True)  # -> Item, Item1
Z_2 = UnitZ(Factor=number_slider)
c_script_5 = CSharpScript(vects=vec_5, p1=crv_6, height=number_slider)  # -> out, A; inputs vects: list of Vector3d, p1: Polyline, height: Double
# ---------- c_script_5: C# ----------
    var p2 = p1.ToPolylineCurve();
    p2.Translate(new Vector3d(0, 0, height));
    //    for (int i = 0; i < p2.PointCount-1; i++)
    //    {
    //
    //    }

    var pt = p2.Point(1);

    var pts = vects.Select(x => Intersection(pt, x)).ToList();

    A = pts;
# ---------- c_script_5: C# additional code ----------
  public Point3d Intersection(Point3d pt, Vector3d v)
  {
    var line = new Line(pt, v, double.MaxValue);
    double t;
    Rhino.Geometry.Intersect.Intersection.LinePlane(line, Plane.WorldXY, out t);
    return line.PointAt(t);
  }
# ---------- end c_script_5 ----------
move_2 = Move(Geometry=item_2.Item1, Motion=Z_2)  # -> Geometry, Transform
pline_3 = PolyLine(Vertices=c_script_5.A, Closed=False)
ln_2 = Line(StartPoint=move_2.Geometry, EndPoint=c_script_5.A)
